# Grasshopper definition windrose_plot.gh (Grasshopper 1.0.7)

panel = Panel("https://www.energyplus.net/weather-download/asia_wmo_region_2/CHN//CHN_Beijing.Beijing.545110_SWERA/all")
downloadepw = LBDownloadWeather(weather_URL=panel)  # -> epw_file, stat_file, ddy_file; plug-in component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
importepw = LBImportEPW(epw_file=downloadepw.epw_file)  # -> location, dry_bulb_temperature, dew_point_temperature, relative_humidity, wind_speed, wind_direction, direct_normal_rad, diffuse_horizontal_rad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; plug-in component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
windrose = LBWindRose(
    data=[importepw.wind_speed, importepw.dry_bulb_temperature],
    wind_direction=importepw.wind_direction,
    show_calmrose=Toggle(True),
    show_freq=Toggle(True),
    freq_hours="100",
    statement="0 <= a < 25 and 10 < b < 25")  # -> report, mesh, compass, orient_line, freq_line, windrose_line, legend, title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; plug-in component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
bang = ExplodeTree(Data=graft(windrose.histogram))  # -> Branch0, Branch1
xmatrix = LBDeconstructMatrix(matrix=bang.Branch0)  # -> values; plug-in component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
xmatrix_2 = LBDeconstructMatrix(matrix=bang.Branch1)  # -> values; plug-in component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
avr = Average(Input=xmatrix)
lng = ListLength(List=xmatrix_2)
panel_2 = Panel(avr)
panel_3 = Panel(lng)
